# Grasshopper definition DLT_Mechanical Model.gh (Grasshopper 1.0.8)
# plug-ins: Karamba3D, Pufferfish

# ----
# Define Lamination Curves
convert_from_in_to_m = Panel("0.0254")
width_of_boards = Panel("1.5")
number_of_boards = Slider(40, range=0..100)
multiplication = Multiplication(A=convert_from_in_to_m, B=width_of_boards)
series = Series(Start=0, Step=multiplication, Count=number_of_boards)
span_m = Slider(6, range=0.25..10.25)
addition = Addition(A="0", B=span_m)
pt = ConstructPoint(XCoordinate="0", YCoordinate=series, ZCoordinate=0)
pt_2 = ConstructPoint(XCoordinate=addition, YCoordinate=series, ZCoordinate=0)
ln = Line(StartPoint=pt, EndPoint=pt_2)

# ---- group: Mirror Plane
division = Division(A=span_m, B="2")
pt_3 = ConstructPoint(XCoordinate=division, YCoordinate=0, ZCoordinate=0)
yz = YZPlane(Origin=pt_3)

# ---- group: Minimum Edge Distance
convert_from_in_to_m_2 = Panel("0.0254")
min_edge_distance = Panel("1.5")
multiplication_2 = Multiplication(A=convert_from_in_to_m_2, B=min_edge_distance)

# ----
cir = Circle(Plane=PlaneXY(0, 0, 0), Radius=1)

# ---- group: Specific weight
density_of_water_kg_m3 = Panel("1000")
sg = Panel("0.68")
multiplication_3 = Multiplication(A=sg, B=density_of_water_kg_m3)
gravity_m_s2 = Panel("9.81")
multiplication_4 = Multiplication(A=multiplication_3, B=gravity_m_s2)
convert_from_n_m3_to_kn_m3 = Panel("1000")
division_2 = Division(A=multiplication_4, B=convert_from_n_m3_to_kn_m3)

# ---- group: Stresses
fv_kpa = Panel("13800")
fb_kpa = Panel("105000")
convert_kpa_to_kn_cm_2 = Panel("0.0001")
convert_kpa_to_kn_cm_2_2 = Panel("0.0001")
multiplication_5 = Multiplication(A=fb_kpa)
multiplication_6 = Multiplication(A=fv_kpa)
multiplication_7 = Multiplication(A=multiplication_5, B=convert_kpa_to_kn_cm_2)
multiplication_8 = Multiplication(A=multiplication_6, B=convert_kpa_to_kn_cm_2_2)
neg = Negative(Value=multiplication_7)

# ---- group: E to E0.05
cove = Panel("0.25")
e_psi = Panel("1400000")
multiplication_9 = Multiplication(A="1.645", B=cove)
subtraction = Subtraction(A="1", B=multiplication_9)
multiplication_10 = Multiplication(A=e_psi, B=subtraction)

# ---- group: Modulus of elasticity and shear modulus
e_mpa = Panel("12300")
emin_mpa = Panel("970")
convert_mpa_to_kn_cm_2 = Panel("0.1")
convert_mpa_to_kn_cm_2_2 = Panel("0.1")
convert_mpa_to_kn_cm_2_3 = Panel("0.1")
g_mpa = Panel("1160")
multiplication_11 = Multiplication(A=e_mpa, B=convert_mpa_to_kn_cm_2_2)
multiplication_12 = Multiplication(A=emin_mpa, B=convert_mpa_to_kn_cm_2)
multiplication_13 = Multiplication(A=g_mpa, B=convert_mpa_to_kn_cm_2_3)

# ----
# Hardwood Dowels (White Oak)
panel = Panel("Oak")
matprops = MaterialPropertiesKaramba3D(
    FamilyOfMaterial="Steel",
    Name=panel,
    YoungsModulusKNCm²Dir1=multiplication_11,
    YoungsModulusKNCm²Dir2=multiplication_12,
    InPlaneShearModulus_kN_cm²=multiplication_13,
    InPlaneLateralContractionCoefficient=-1,
    TransverseShearModulusKNCm²Dir1=8076,
    TransverseShearModulusKNCm²Dir2=8076,
    SpecificWeight_kN_m³=division_2,
    CoefficientOfThermalExpansion1Dir1=1.2e-05,
    CoefficientOfThermalExpansion1Dir2=1.2e-05,
    TensileStrengthKNCm²Dir1=multiplication_7,
    TensileStrengthKNCm²Dir2=multiplication_7,
    CompressiveStrengthKNCm²Dir1=neg,
    CompressiveStrengthKNCm²Dir2=neg,
    ShearStrengthKNCm²Dir12=multiplication_8,
    TsaiWuIntCoeff=0,
    StrengthHypothesis="MISES",
    mode="Orthotropic")
dowel_diameter_cm = Panel("2")
division_3 = Division(A=dowel_diameter_cm, B="2")
crosec = CrossSectionKaramba3D(
    FamilyNameOfCrossSection="DefaultCroSec",
    Material=matprops,
    Diameter_cm=dowel_diameter_cm,
    WallThickness_cm=division_3,
    mode="Circular Hollow")

# ---- group: Specific weight
sg_2 = Panel("0.42")
density_of_water_kg_m3_2 = Panel("1000")
multiplication_14 = Multiplication(A=sg_2, B=density_of_water_kg_m3_2)
gravity_m_s2_2 = Panel("9.81")
multiplication_15 = Multiplication(A=multiplication_14, B=gravity_m_s2_2)
convert_from_n_m3_to_kn_m3_2 = Panel("1000")
division_4 = Division(A=multiplication_15, B=convert_from_n_m3_to_kn_m3_2)

# ---- group: Modulus of elasticity and shear modulus
convert_psi_to_mpa = Panel("0.00689476")
emin_psi = Panel("510000")
division_5 = Division(A=multiplication_10, B="16")
multiplication_16 = Multiplication(A=multiplication_10, B=convert_psi_to_mpa)
convert_mpa_to_kn_cm_2_4 = Panel("0.1")
multiplication_17 = Multiplication(A=emin_psi, B=convert_psi_to_mpa)
multiplication_18 = Multiplication(A=division_5, B=convert_psi_to_mpa)
multiplication_19 = Multiplication(A=multiplication_16, B=convert_mpa_to_kn_cm_2_4)
multiplication_20 = Multiplication(A=multiplication_17, B=convert_mpa_to_kn_cm_2_4)
multiplication_21 = Multiplication(A=multiplication_18, B=convert_mpa_to_kn_cm_2_4)

# ----
cross_section_depth_in = Panel("11.25")
width_of_boards_in = Panel("1.5")
convert_from_in_to_m_3 = Panel("0.0254")
convert_from_in_to_m_4 = Panel("0.0254")
convert_from_m_to_cm = Panel("100")
convert_from_m_to_cm_2 = Panel("100")
multiplication_22 = Multiplication(A=convert_from_in_to_m_4, B=width_of_boards_in)
multiplication_23 = Multiplication(A=convert_from_in_to_m_3, B=cross_section_depth_in)
multiplication_24 = Multiplication(A=multiplication_22, B=convert_from_m_to_cm_2)
multiplication_25 = Multiplication(A=multiplication_23, B=convert_from_m_to_cm)

# ---- group: Cf
cross_section_depths = Panel("""3.5
5.5
7.25
9.25
11.25""")
cf = Panel("""1.5
1.3
1.2
1.1
1.0""")
mindex = MemberIndex(Set=flatten(cross_section_depth_in), Member=cross_section_depths)  # -> simplify(Index), Count
flip = FlipMatrix(Data=mindex.Index)
index = ItemIndex(List=flip, Item=mindex.Index)
item = ListItem(List=cf, Index=index, Wrap=True)  # -> flatten(Item)

# ---- group: Design strengths
fb_psi = Panel("875")
cr = Panel("1.15")
multiplication_26 = Multiplication(A=fb_psi, B=cr)
convert_psi_to_kpa = Panel("6.89476")
convert_psi_to_kpa_2 = Panel("6.89476")
fv_psi = Panel("135")
multiplication_27 = Multiplication(A=multiplication_26, B=item)
multiplication_28 = Multiplication(A=multiplication_27, B=convert_psi_to_kpa)
multiplication_29 = Multiplication(A=fv_psi, B=convert_psi_to_kpa_2)
convert_kpa_to_kn_cm_2_3 = Panel("0.0001")
convert_kpa_to_kn_cm_2_4 = Panel("0.0001")
multiplication_30 = Multiplication(A=multiplication_28, B=convert_kpa_to_kn_cm_2_3)
multiplication_31 = Multiplication(A=multiplication_29, B=convert_kpa_to_kn_cm_2_4)
neg_2 = Negative(Value=multiplication_30)

# ----
# No. 2 SPF Wood Properties - Direction 1 Parallel
panel_2 = Panel("No. 2 SPF")
matprops_2 = MaterialPropertiesKaramba3D(
    FamilyOfMaterial="Steel",
    Name=panel_2,
    YoungsModulusKNCm²Dir1=multiplication_19,
    YoungsModulusKNCm²Dir2=multiplication_20,
    InPlaneShearModulus_kN_cm²=multiplication_21,
    InPlaneLateralContractionCoefficient=-1,
    TransverseShearModulusKNCm²Dir1=8076,
    TransverseShearModulusKNCm²Dir2=8076,
    SpecificWeight_kN_m³=division_4,
    CoefficientOfThermalExpansion1Dir1=1.2e-05,
    CoefficientOfThermalExpansion1Dir2=1.2e-05,
    TensileStrengthKNCm²Dir1=multiplication_30,
    TensileStrengthKNCm²Dir2=multiplication_30,
    CompressiveStrengthKNCm²Dir1=neg_2,
    CompressiveStrengthKNCm²Dir2=neg_2,
    ShearStrengthKNCm²Dir12=multiplication_31,
    TsaiWuIntCoeff=0,
    StrengthHypothesis="MISES",
    mode="Orthotropic")
crosec_2 = CrossSectionKaramba3D(
    FamilyNameOfCrossSection="DefaultCroSec",
    Material=matprops_2,
    Height_cm=multiplication_25,
    UpperFlangeWidth_cm=multiplication_24,
    LowerFlangeWidth_cm=multiplication_24,
    mode="Trapezoid")

# ---- group: Stiffness values / Translational stiffness (Y)
division_6 = Division(A=multiplication_24, B="2")
convert_m_to_cm = Panel("100")
multiplication_32 = Multiplication(A=division_6, B=dowel_diameter_cm)
multiplication_33 = Multiplication(A=division_6, B=dowel_diameter_cm)
multiplication_34 = Multiplication(A=multiplication_2, B=convert_m_to_cm)
division_7 = Division(A=dowel_diameter_cm, B="2")
multiplication_35 = Multiplication(A=multiplication_33, B=multiplication_12)
multiplication_36 = Multiplication(A=multiplication_32, B=multiplication_19)
division_8 = Division(A=multiplication_36, B=multiplication_34)
integer_division = IntegerDivision(A=multiplication_35, B=division_7)
convert_kn_cm_to_kn_m = Panel("100")
convert_kn_cm_to_kn_m_2 = Panel("100")
multiplication_37 = Multiplication(A=division_8, B=convert_kn_cm_to_kn_m)
multiplication_38 = Multiplication(A=integer_division, B=convert_kn_cm_to_kn_m_2)
one_over_x = OneOverX(Value=multiplication_38)
one_over_x_2 = OneOverX(Value=multiplication_37)
addition_2 = Addition(A=one_over_x, B=one_over_x_2)
one_over_x_3 = OneOverX(Value=addition_2)

# ---- group: Stiffness values / Translational stiffness (Z)
division_9 = Division(A=multiplication_24, B="2")
division_10 = Division(A=multiplication_25, B="2")
multiplication_39 = Multiplication(A=division_9, B=dowel_diameter_cm)
multiplication_40 = Multiplication(A=division_9, B=dowel_diameter_cm)
division_11 = Division(A=dowel_diameter_cm, B="2")
subtraction_2 = Subtraction(A=division_10, B=division_11)
multiplication_41 = Multiplication(A=multiplication_40, B=multiplication_12)
multiplication_42 = Multiplication(A=multiplication_39, B=multiplication_20)
division_12 = Division(A=multiplication_42, B=subtraction_2)
integer_division_2 = IntegerDivision(A=multiplication_41, B=division_11)
convert_kn_cm_to_kn_m_3 = Panel("100")
convert_kn_cm_to_kn_m_4 = Panel("100")
multiplication_43 = Multiplication(A=division_12, B=convert_kn_cm_to_kn_m_3)
multiplication_44 = Multiplication(A=integer_division_2, B=convert_kn_cm_to_kn_m_4)
one_over_x_4 = OneOverX(Value=multiplication_44)
one_over_x_5 = OneOverX(Value=multiplication_43)
addition_3 = Addition(A=one_over_x_4, B=one_over_x_5)
one_over_x_6 = OneOverX(Value=addition_3)

# ---- group: Live load
convert_psf_to_psi = Panel("144")
live_load_psf = Panel("100")
division_13 = Division(A=live_load_psf, B=convert_psf_to_psi)
multiplication_45 = Multiplication(A=division_13, B=width_of_boards_in)
convert_lbs_in_to_kn_m = Panel("0.175126835")
multiplication_46 = Multiplication(A=multiplication_45, B=convert_lbs_in_to_kn_m)
neg_3 = Negative(Value=multiplication_46)

# ----
# Structural Analysis
# Segmented laminations
crv = Curve(ln)
board_division = Slider(3, range=0..10)
panel_3 = Panel("0")
relay = Relay()
supp = SupportKaramba3D(PosInd=pt, menu=[buttons(on, on, on, off, off, off)])
supp_2 = SupportKaramba3D(PosInd=pt_2, menu=[buttons(off, on, on, off, off, off)])

# ---- group: Model II Dowel joints
pt_4 = ConstructPoint(XCoordinate="0", YCoordinate=one_over_x_3, ZCoordinate=one_over_x_6)
pt_5 = ConstructPoint(XCoordinate="0", YCoordinate=0, ZCoordinate=0)
joint_agent = BeamJointAgentKaramba3D(
    BeamIdentifier="Dowels",
    ToElementIdentifiers=["Starts", "Middles", "Ends"],
    Ct_kN_m=pt_4,
    Cr_kNm_rad=pt_5,
    menu=[buttons(on, on, on, on, off, off)])

# ---- group: Board end-to-end joints
pt_6 = ConstructPoint(XCoordinate="0", YCoordinate="0", ZCoordinate="0")
joint_agent_2 = BeamJointAgentKaramba3D(
    BeamIdentifier="Starts",
    ToElementIdentifiers="Ends",
    Ct_kN_m=pt_6,
    Cr_kNm_rad=pt_6,
    menu=[buttons(on, on, on, on, on, on)])

# ---- group: Loads
Z = UnitZ(Factor=neg_3)
beam_loads = BeamLoadsKaramba3D(
    BeamIdentifier=["Starts", "Middles", "Ends"],
    LoadCase="LC0",
    ForceVector=Z,
    TStart=0,
    TEnd=1,
    mode="Block",
    menu=[buttons(on, off, off)])
loads = LoadsKaramba3D(Vector=Vector(0, 0, -1), LCase="LC0", mode="Gravity")

# ----
# Board Geometry
panel_4 = Panel("0 to 1")

# ----
# Dowel Geometry
len = Length(Curve=crv)
concat = Concatenate(FragmentA="0 to ", FragmentB=len)
crvdom = CurveDomain(Curve=crv, Domain=concat)  # -> Curve, Domain
dowel_spacing = Slider(0.15, range=0.1..0.5)
subtraction_3 = Subtraction(A=number_of_boards, B="1")
multiplication_47 = Multiplication(A=multiplication_2, B=subtraction_3)
Y = UnitY(Factor=1)

crvdom_2 = CurveDomain(Curve=crvdom.Curve, Domain=crvdom.Domain)  # -> Curve, Domain

dedomain = DeconstructDomain(Domain=crvdom_2.Domain)  # -> Start, End
subtraction_4 = Subtraction(A=dedomain.End, B=multiplication_2)
addition_4 = Addition(A=dedomain.Start, B=multiplication_2)
dom = ConstructDomain(DomainStart=addition_4, DomainEnd=subtraction_4)
subcrv = SubCurve(BaseCurve=crvdom.Curve, Domain=dom)

crvdom_3 = CurveDomain(Curve=subcrv, Domain=panel_4)  # -> Curve, Domain
len_2 = Length(Curve=crvdom_3.Curve)
division_14 = Division(A=multiplication_2, B=len_2)
item_2 = ListItem(List=division_14, Index=0, Wrap=True)

item_3 = ListItem(List=subcrv, Index=0, Wrap=True)

len_3 = Length(Curve=item_3)
division_15 = Division(A=len_3, B=dowel_spacing)
divide = DivideCurve(Curve=item_3, Count=division_15, Kinks=False)  # -> Points, Tangents, Parameters
line = LineSDL(Start=divide.Points, Direction=Y, Length=multiplication_47)  # -> simplify(Line)
suirify = Suirify(line)
graft = GraftTree(Tree=suirify, IncludeEmptyLists=True, IncludeNullItems=True)  # -> simplify(Tree)

remap = RemapNumbers(Value=divide.Parameters, Source=crvdom_3.Domain, Target=panel_4)  # -> Mapped, Clipped

# ---- group: Remap lamination curve domains to exclude min edge distance from dowels
shatter = Shatter(Curve=crvdom_3.Curve, Parameters=remap.Mapped)  # -> simplify(Segments)
flip_2 = FlipMatrix(Data=shatter)
item_4 = ListItem(List=flip_2, Index=0, Wrap=True)  # -> flatten(Item)
dedomain_2 = DeconstructDomain(Domain=flatten(item_4))  # -> Start, End
subtraction_5 = Subtraction(A=dedomain_2.End, B=item_2)
addition_5 = Addition(A=dedomain_2.Start, B=item_2)
dom_2 = ConstructDomain(DomainStart=addition_5, DomainEnd=subtraction_5)
subcrv_2 = SubCurve(BaseCurve=shatter, Domain=dom_2)  # -> simplify(Curve)
recrvdom = RemapCurveDomain(Curve=subcrv_2, Guide=shatter)  # -> Remapped, Original, New
crv_2 = Curve(simplify(recrvdom.Remapped))

# ---- group: Divide curves into boards and remap / N+1
shift = ShiftList(List=crv, Shift=1, Wrap=True)
culln = CullNth(List=shift, CullFrequency=2)

# ---- group: Divide curves into boards and remap / N
culln_2 = CullNth(List=crv, CullFrequency=2)  # -> simplify(List)
flip_3 = FlipMatrix(Data=crv_2)
culln_3 = CullNth(List=flip_3, CullFrequency=2)  # -> simplify(List)
crvdom_4 = CurveDomain(Curve=culln_3)  # -> Curve, Domain

# ---- group: Divide curves into boards and remap / N+1 (continued)
shift_2 = ShiftList(List=flip_3, Shift=1, Wrap=True)
culln_4 = CullNth(List=shift_2, CullFrequency=2)  # -> simplify(List)
crvdom_5 = CurveDomain(Curve=culln_4)  # -> Curve, Domain

# ----
crvdom_6 = CurveDomain(Curve=culln, Domain="0 to 1")  # -> Curve, Domain
crvdom_7 = CurveDomain(Curve=culln_2, Domain="0 to 1")  # -> Curve, Domain

# ---- group: Divide curves into boards and remap / N+1 (continued)
divide_2 = DivideCurve(Curve=crvdom_6.Curve, Count=board_division, Kinks=False)  # -> Points, Tangents, simplify(Parameters)
shatter_2 = Shatter(Curve=crvdom_6.Curve, Parameters=flatten(divide_2.Parameters))  # -> simplify(Segments)
midpt = CurveMiddle(Curve=shatter_2)
crv_cp = CurveClosestPoint(Point=midpt, Curve=graft(crvdom_6.Curve))  # -> Point, simplify(Parameter), Distance
flip_4 = FlipMatrix(Data=crv_cp.Parameter)
item_5 = ListItem(List=flip_4, Index=0, Wrap=True)  # -> flatten(Item)
cull_i = CullIndex(List=item_5, Indices="0", Wrap=True)
lastdex = LastIndex(List=cull_i)
cull_i_2 = CullIndex(List=cull_i, Indices=lastdex, Wrap=True)
inc = Includes(Value=cull_i_2, Domain=crvdom_5.Domain)  # -> Includes, Deviation
dispatch = Dispatch(List=cull_i_2, DispatchPattern=inc.Includes)  # -> ListA, ListB
eval = EvaluateCurve(Curve=crvdom_5.Curve, Parameter=graft(dispatch.ListA))  # -> Point, Tangent, Angle
ptplnside = PointPlaneSide(Point=eval.Point, Plane=yz)  # -> Side, Front, Back, Distance
dispatch_2 = Dispatch(List=eval.Point, DispatchPattern=ptplnside.Back)  # -> ListA, ListB
mirror = Mirror(Geometry=dispatch_2.ListA, Plane=yz)  # -> Geometry, Transform
flip_5 = FlipMatrix(Data=dispatch_2.ListA)
flip_6 = FlipMatrix(Data=mirror.Geometry)
merge = Merge(Data1=flip_5, Data2=flip_6)
flip_7 = FlipMatrix(Data=merge)
clean = CleanTree(RemoveNulls=True, RemoveInvalid=True, RemoveEmpty=False, Tree=flip_7)
crv_cp_2 = CurveClosestPoint(Point=clean, Curve=crvdom_6.Curve)  # -> Point, simplify(Parameter), Distance
item_6 = ListItem(List=crv_cp_2.Parameter, Index=0, Wrap=True)  # -> flatten(Item)
shatter_3 = Shatter(Curve=crvdom_6.Curve, Parameters=item_6)  # -> simplify(Segments)
path_mapper = PathMapper(shatter_3, source="{A}", target="{2*A+1}")

# ---- group: Divide curves into boards and remap / N (continued)
divide_3 = DivideCurve(Curve=crvdom_7.Curve, Count=board_division, Kinks=False)  # -> Points, Tangents, simplify(Parameters)
flip_8 = FlipMatrix(Data=divide_3.Parameters)
item_7 = ListItem(List=flip_8, Index=0, Wrap=True)  # -> flatten(Item)
cull_i_3 = CullIndex(List=item_7, Indices="0", Wrap=True)
lastdex_2 = LastIndex(List=cull_i_3)
cull_i_4 = CullIndex(List=cull_i_3, Indices=lastdex_2, Wrap=True)
inc_2 = Includes(Value=cull_i_4, Domain=crvdom_4.Domain)  # -> Includes, Deviation
dispatch_3 = Dispatch(List=cull_i_4, DispatchPattern=inc_2.Includes)  # -> graft(ListA), ListB
eval_2 = EvaluateCurve(Curve=crvdom_4.Curve, Parameter=dispatch_3.ListA)  # -> Point, Tangent, Angle
ptplnside_2 = PointPlaneSide(Point=eval_2.Point, Plane=yz)  # -> Side, Front, Back, Distance
dispatch_4 = Dispatch(List=eval_2.Point, DispatchPattern=ptplnside_2.Front)  # -> ListA, ListB
mirror_2 = Mirror(Geometry=dispatch_4.ListA, Plane=yz)  # -> Geometry, Transform
flip_9 = FlipMatrix(Data=dispatch_4.ListA)
flip_10 = FlipMatrix(Data=mirror_2.Geometry)
merge_2 = Merge(Data1=flip_9, Data2=flip_10)
flip_11 = FlipMatrix(Data=merge_2)
clean_2 = CleanTree(RemoveNulls=True, RemoveInvalid=True, RemoveEmpty=False, Tree=flip_11)
crv_cp_3 = CurveClosestPoint(Point=clean_2, Curve=crvdom_7.Curve)  # -> Point, simplify(Parameter), Distance
item_8 = ListItem(List=crv_cp_3.Parameter, Index=0, Wrap=True)  # -> flatten(Item)
shatter_4 = Shatter(Curve=crvdom_7.Curve, Parameters=item_8)  # -> simplify(Segments)

# ---- group: Divide curves into boards and remap
path_mapper_2 = PathMapper(shatter_4, source="{A}", target="{2*A}")

# ----
merge_3 = Merge(Data1=path_mapper_2, Data2=path_mapper)

# ---- group: Board info
convert_m_to_ft = Panel("3.28084")
lng = ListLength(List=flatten(merge_3))  # -> flatten(Length)
lng_2 = ListLength(List=merge_3)
len_4 = Length(Curve=merge_3)
multiplication_48 = Multiplication(A=len_4, B=convert_m_to_ft)
number_of_boards_per_lamination = Panel(lng_2)
number_of_boards_per_slab = Panel(lng)
length_of_boards_ft = Panel(multiplication_48)

# ----
panel_5 = Panel(len_4)

# ----
# Starts, Middles, Ends and Dowels
flip_12 = FlipMatrix(Data=merge_3)
flip_13 = FlipMatrix(Data=shatter_4)
flip_14 = FlipMatrix(Data=shatter_3)
ccx = CurveCurve(CurveA=flatten(flip_13), CurveB=graft)  # -> Points, simplify(ParamsA), simplify(ParamsB)
ccx_2 = CurveCurve(CurveA=flatten(flip_14), CurveB=graft)  # -> Points, simplify(ParamsA), simplify(ParamsB)
ccx_3 = CurveCurve(CurveA=flatten(flip_12), CurveB=graft)  # -> Points, simplify(ParamsA), simplify(ParamsB)
trim = TrimTree(Tree=ccx.ParamsA, Depth=1)
trim_2 = TrimTree(Tree=ccx_2.ParamsA, Depth=1)
shatter_5 = Shatter(Curve=flatten(shatter_4), Parameters=flatten(trim))  # -> simplify(ShatteredBoardsN)
shatter_6 = Shatter(Curve=flatten(shatter_3), Parameters=flatten(trim_2))  # -> simplify(ShatteredBoardsN1)
clean_3 = CleanTree(RemoveNulls=True, RemoveInvalid=True, RemoveEmpty=True, Tree=ccx_3.ParamsB)
lng_3 = ListLength(List=shatter_4)  # -> flatten(Length)
trim_3 = TrimTree(Tree=clean_3, Depth=1)
lng_4 = ListLength(List=shatter_3)  # -> flatten(Length)
flip_15 = FlipMatrix(Data=trim_3)

lng_5 = ListLength(List=shatter_5)  # -> flatten(Length)
lng_6 = ListLength(List=shatter_6)  # -> flatten(Length)
item_9 = ListItem(List=flip_15, Index=0, Wrap=True)  # -> flatten(Item)
lng_7 = ListLength(List=lng_5)  # -> flatten(Length)
lng_8 = ListLength(List=lng_6)  # -> flatten(Length)
series_2 = Series(Start=0, Step=1, Count=lng_7)
series_3 = Series(Start=0, Step=1, Count=lng_8)
division_16 = Division(BranchIndex=series_2, NumberOfGroups=lng_3)  # -> flatten(GroupIndex)
mod = Modulus(BranchIndex=series_2, NumberOfGroups=lng_3)  # -> simplify(graft(NewBranchIndex))
division_17 = Division(BranchIndex=series_3, NumberOfGroups=lng_4)  # -> flatten(GroupIndex)
mod_2 = Modulus(BranchIndex=series_3, NumberOfGroups=lng_4)  # -> simplify(graft(NewBranchIndex))
round = Round(Number=division_16)  # -> Nearest, simplify(graft(Floor)), Ceiling
round_2 = Round(Number=division_17)  # -> Nearest, simplify(graft(Floor)), Ceiling
merge_4 = Merge(Data1=round.Floor, Data2=mod)
merge_5 = Merge(Data1=round_2.Floor, Data2=mod_2)
path = ConstructPath(Indices=merge_4)  # -> flatten(Branch)
path_2 = ConstructPath(Indices=merge_5)  # -> flatten(Branch)
tstat = TreeStatistics(Tree=shatter_5)  # -> Paths, Length, Count
tstat_2 = TreeStatistics(Tree=shatter_6)  # -> Paths, Length, Count
replace = ReplacePaths(Data=shatter_5, Search=tstat.Paths, Replace=path)
replace_2 = ReplacePaths(Data=shatter_6, Search=tstat_2.Paths, Replace=path_2)

shatter_7 = Shatter(Curve=line, Parameters=item_9)  # -> simplify(ShatteredDowels)
path_mapper_3 = PathMapper(replace, source="{A;B}", target="{2*A;B}")
path_mapper_4 = PathMapper(replace_2, source="{A;B}", target="{2*A+1;B}")
merge_6 = Merge(Data1=path_mapper_3, Data2=path_mapper_4)
item_10 = ListItem(List=merge_6, Index=0, Wrap=False)
cull_i_5 = CullIndex(List=merge_6, Indices=item_10, Wrap=False)  # -> simplify(List)
lastdex_3 = LastIndex(List=cull_i_5)
item_11 = ListItem(List=cull_i_5, Index=lastdex_3, Wrap=False)
cull_i_6 = CullIndex(List=cull_i_5, Indices=lastdex_3, Wrap=False)  # -> simplify(List)
clean_4 = CleanTree(RemoveNulls=True, RemoveInvalid=True, RemoveEmpty=False, Tree=cull_i_6)
clean_5 = CleanTree(RemoveNulls=True, RemoveInvalid=True, RemoveEmpty=False, Tree=item_11)
clean_6 = CleanTree(RemoveNulls=True, RemoveInvalid=True, RemoveEmpty=False, Tree=item_10)

# ----
# Continuous laminations
merge_7 = Merge(Data1=culln_2, Data2=culln)
dowels = Curve(simplify(shatter_7))
lineelem = CreateLinearElementKaramba3D(
    Line=dowels,
    Identifier="Dowels",
    CrossSection=crosec,
    LimitDistance_m=0.005,
    BucklingLengthY_m=-1,
    BucklingLengthZ_m=-1,
    BucklingLengthLT_m=-1,
    Bending=True,
    ToPolylineMaxAngle=0.03,
    ToPolylineTolerance=0.01,
    ToPolylineMaxEdgeLength=0.25,
    New=True,
    Remove=True,
    mode="LineToBeam")  # -> Element, Points, Info
supp_3 = SupportKaramba3D(PosInd=pt, menu=[buttons(on, on, on, off, off, off)])
supp_4 = SupportKaramba3D(PosInd=pt_2, menu=[buttons(off, on, on, off, off, off)])

# ---- group: Discretized board curves
ccx_4 = CurveCurve(CurveA=merge_7, CurveB=graft)  # -> Points, flatten(ParamsA), flatten(ParamsB)
shatter_8 = Shatter(Curve=merge_7, Parameters=ccx_4.ParamsA)  # -> simplify(Segments)
cull_i_7 = CullIndex(List=shatter_8, Indices="0", Wrap=True)
item_12 = ListItem(List=shatter_8, Index=0, Wrap=True)
lastdex_4 = LastIndex(List=cull_i_7)
cull_i_8 = CullIndex(List=cull_i_7, Indices=lastdex_4, Wrap=True)
item_13 = ListItem(List=cull_i_7, Index=lastdex_4, Wrap=True)

# ---- group: Loads
Z_2 = UnitZ(Factor="-0.18")
beam_loads_2 = BeamLoadsKaramba3D(
    BeamIdentifier=["Starts", "Middles", "Ends"],
    LoadCase="LC0",
    ForceVector=Z_2,
    TStart=0,
    TEnd=1,
    mode="Block",
    menu=[buttons(on, off, off)])
loads_2 = LoadsKaramba3D(Vector=Vector(0, 0, -1), LCase="LC0", mode="Gravity")

# ---- group: End to end joints
pt_7 = ConstructPoint(XCoordinate="0", YCoordinate="0", ZCoordinate="0")
joint_agent_3 = BeamJointAgentKaramba3D(
    BeamIdentifier="Starts",
    ToElementIdentifiers="Ends",
    Ct_kN_m=pt_7,
    Cr_kNm_rad=pt_7,
    menu=[buttons(on, on, on, on, on, on)])

# ---- group: Model II Dowel joints
joint_agent_4 = BeamJointAgentKaramba3D(
    BeamIdentifier="Dowels",
    ToElementIdentifiers=["Starts", "Middles", "Ends"],
    Ct_kN_m=pt_4,
    Cr_kNm_rad=pt_5,
    menu=[buttons(on, on, on, on, off, off)])

# ----
# Hybrid laminations
merge_8 = Merge(Data1=path_mapper_2, Data2=culln)
dowels_2 = Curve(simplify(shatter_7))
lineelem_2 = CreateLinearElementKaramba3D(
    Line=dowels_2,
    Identifier="Dowels",
    CrossSection=crosec,
    LimitDistance_m=0.005,
    BucklingLengthY_m=-1,
    BucklingLengthZ_m=-1,
    BucklingLengthLT_m=-1,
    Bending=True,
    ToPolylineMaxAngle=0.03,
    ToPolylineTolerance=0.01,
    ToPolylineMaxEdgeLength=0.25,
    New=True,
    Remove=True,
    mode="LineToBeam")  # -> Element, Points, Info
supp_5 = SupportKaramba3D(PosInd=pt, menu=[buttons(on, on, on, off, off, off)])
supp_6 = SupportKaramba3D(PosInd=pt_2, menu=[buttons(off, on, on, off, off, off)])

lng_9 = ListLength(List=flatten(merge_8))  # -> flatten(Length)

# ---- group: Discretized board curves
ccx_5 = CurveCurve(CurveA=merge_8, CurveB=graft)  # -> Points, flatten(ParamsA), flatten(ParamsB)
shatter_9 = Shatter(Curve=merge_8, Parameters=ccx_5.ParamsA)  # -> simplify(Segments)
cull_i_9 = CullIndex(List=shatter_9, Indices="0", Wrap=True)
item_14 = ListItem(List=shatter_9, Index=0, Wrap=True)
lastdex_5 = LastIndex(List=cull_i_9)
cull_i_10 = CullIndex(List=cull_i_9, Indices=lastdex_5, Wrap=True)
item_15 = ListItem(List=cull_i_9, Index=lastdex_5, Wrap=True)

# ----
number_of_boards_2 = Panel(lng_9)

# ---- group: Loads
Z_3 = UnitZ(Factor="-0.18")
beam_loads_3 = BeamLoadsKaramba3D(
    BeamIdentifier=["Starts", "Middles", "Ends"],
    LoadCase="LC0",
    ForceVector=Z_3,
    TStart=0,
    TEnd=1,
    mode="Block",
    menu=[buttons(on, off, off)])
loads_3 = LoadsKaramba3D(Vector=Vector(0, 0, -1), LCase="LC0", mode="Gravity")

# ---- group: End to end joints
pt_8 = ConstructPoint(XCoordinate="0", YCoordinate="0", ZCoordinate="0")
joint_agent_5 = BeamJointAgentKaramba3D(
    BeamIdentifier="Starts",
    ToElementIdentifiers="Ends",
    Ct_kN_m=pt_8,
    Cr_kNm_rad=pt_8,
    menu=[buttons(on, on, on, on, on, on)])

# ---- group: Model II Dowel joints
joint_agent_6 = BeamJointAgentKaramba3D(
    BeamIdentifier="Dowels",
    ToElementIdentifiers=["Starts", "Middles", "Ends"],
    Ct_kN_m=pt_4,
    Cr_kNm_rad=pt_5,
    menu=[buttons(on, on, on, on, off, off)])

# ----
starts = Curve(clean_6)
middles = Curve(simplify(clean_4))
ends = Curve(simplify(clean_5))
dowels_3 = Curve(simplify(shatter_7))
lineelem_3 = CreateLinearElementKaramba3D(
    Line=starts,
    Identifier="Starts",
    CrossSection=crosec_2,
    LimitDistance_m=0.005,
    BucklingLengthY_m=-1,
    BucklingLengthZ_m=-1,
    BucklingLengthLT_m=-1,
    Bending=True,
    ToPolylineMaxAngle=0.03,
    ToPolylineTolerance=0.01,
    ToPolylineMaxEdgeLength=0.25,
    New=True,
    Remove=True,
    mode="LineToBeam")  # -> Element, Points, Info
lineelem_4 = CreateLinearElementKaramba3D(
    Line=middles,
    Identifier="Middles",
    CrossSection=crosec_2,
    LimitDistance_m=0.005,
    BucklingLengthY_m=-1,
    BucklingLengthZ_m=-1,
    BucklingLengthLT_m=-1,
    Bending=True,
    ToPolylineMaxAngle=0.03,
    ToPolylineTolerance=0.01,
    ToPolylineMaxEdgeLength=0.25,
    New=True,
    Remove=True,
    mode="LineToBeam")  # -> Element, Points, Info
lineelem_5 = CreateLinearElementKaramba3D(
    Line=ends,
    Identifier="Ends",
    CrossSection=crosec_2,
    LimitDistance_m=0.005,
    BucklingLengthY_m=-1,
    BucklingLengthZ_m=-1,
    BucklingLengthLT_m=-1,
    Bending=True,
    ToPolylineMaxAngle=0.03,
    ToPolylineTolerance=0.01,
    ToPolylineMaxEdgeLength=0.25,
    New=True,
    Remove=True,
    mode="LineToBeam")  # -> Element, Points, Info
lineelem_6 = CreateLinearElementKaramba3D(
    Line=dowels_3,
    Identifier="Dowels",
    CrossSection=crosec,
    LimitDistance_m=0.005,
    BucklingLengthY_m=-1,
    BucklingLengthZ_m=-1,
    BucklingLengthLT_m=-1,
    Bending=True,
    ToPolylineMaxAngle=0.03,
    ToPolylineTolerance=0.01,
    ToPolylineMaxEdgeLength=0.25,
    New=True,
    Remove=True,
    mode="LineToBeam")  # -> Element, Points, Info
assemble = AssembleModelKaramba3D(
    Elem=flatten([lineelem_4.Element, lineelem_5.Element, lineelem_6.Element, lineelem_3.Element]),
    Support=[supp, supp_2],
    Load=flatten([loads, beam_loads]),
    Joint=flatten([joint_agent_2, joint_agent]),
    LimitDistance_m=0.005)  # -> Model, Info, Mass_kg, CentreOfGravity, LoadCaseNames
analyse = AnalyseKaramba3D(Model=assemble.Model)  # -> AnalysedModel, MaximumDisplacement_cm, ResultingForce_kN, ChangeOfElasticEnergy_kNm
panel_6 = Panel(analyse.MaximumDisplacement_cm)
modelview = ModelViewKaramba3D(Model=analyse.AnalysedModel)  # -> Model, DeformedMesh, DeformedAxes, DeformedModel, MaximumDeformation
beamview = BeamViewKaramba3D(Model=modelview.Model)  # -> Model, MeshesOfRenderedBeams, DeformedBeamAxes, LegendColours, LegendTags
utilization = UtilizationOfElementsKaramba3D(
    AnalysedModel=beamview.Model,
    NumberOfSamplePoints=3,
    ElasticDesign=True,
    GammaM0=1,
    GammaM1=1.1,
    SwayFrame=True,
    WithDetails=True,
    mode="Beams")  # -> Model, Utilization, SigMax_kN_cm², SigMin_kN_cm², TauMax_kN_cm², UtilN, UtilVy, UtilVz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
legend = Legend(Colour=beamview.LegendColours, Tags=beamview.LegendTags, LegendType=1)
sort = SortList(Keys=flatten(utilization.Utilization))  # -> Keys, ValuesA
lastdex_6 = LastIndex(List=sort.Keys)
item_16 = ListItem(List=sort.Keys, Index=lastdex_6, Wrap=True)
multiplication_49 = Multiplication(A=item_16, B="100")

# ---- group: Deflection Limit
convert_m_to_cm_2 = Panel("100")
multiplication_50 = Multiplication(A=span_m, B=convert_m_to_cm_2)
division_18 = Division(A=multiplication_50, B="240")
smaller = SmallerThan(FirstNumber=analyse.MaximumDisplacement_cm, SecondNumber=division_18)  # -> simplify(SmallerThan), OrEqualTo
panel_7 = Panel(smaller.SmallerThan)

# ----
starts_2 = Curve(item_12)
middles_2 = Curve(simplify(cull_i_8))
ends_2 = Curve(simplify(item_13))
lineelem_7 = CreateLinearElementKaramba3D(
    Line=starts_2,
    Identifier="Starts",
    CrossSection=crosec_2,
    LimitDistance_m=0.005,
    BucklingLengthY_m=-1,
    BucklingLengthZ_m=-1,
    BucklingLengthLT_m=-1,
    Bending=True,
    ToPolylineMaxAngle=0.03,
    ToPolylineTolerance=0.01,
    ToPolylineMaxEdgeLength=0.25,
    New=True,
    Remove=True,
    mode="LineToBeam")  # -> Element, Points, Info
lineelem_8 = CreateLinearElementKaramba3D(
    Line=middles_2,
    Identifier="Middles",
    CrossSection=crosec_2,
    LimitDistance_m=0.005,
    BucklingLengthY_m=-1,
    BucklingLengthZ_m=-1,
    BucklingLengthLT_m=-1,
    Bending=True,
    ToPolylineMaxAngle=0.03,
    ToPolylineTolerance=0.01,
    ToPolylineMaxEdgeLength=0.25,
    New=True,
    Remove=True,
    mode="LineToBeam")  # -> Element, Points, Info
lineelem_9 = CreateLinearElementKaramba3D(
    Line=ends_2,
    Identifier="Ends",
    CrossSection=crosec_2,
    LimitDistance_m=0.005,
    BucklingLengthY_m=-1,
    BucklingLengthZ_m=-1,
    BucklingLengthLT_m=-1,
    Bending=True,
    ToPolylineMaxAngle=0.03,
    ToPolylineTolerance=0.01,
    ToPolylineMaxEdgeLength=0.25,
    New=True,
    Remove=True,
    mode="LineToBeam")  # -> Element, Points, Info
assemble_2 = AssembleModelKaramba3D(
    Elem=flatten([lineelem_8.Element, lineelem_9.Element, lineelem.Element, lineelem_7.Element]),
    Support=[supp_3, supp_4],
    Load=flatten([loads_2, beam_loads_2]),
    Joint=flatten([joint_agent_3, joint_agent_4]),
    LimitDistance_m=0.005)  # -> Model, Info, Mass_kg, CentreOfGravity, LoadCaseNames
analyse_2 = AnalyseKaramba3D(Model=assemble_2.Model)  # -> AnalysedModel, MaximumDisplacement_cm, ResultingForce_kN, ChangeOfElasticEnergy_kNm
panel_8 = Panel(analyse_2.MaximumDisplacement_cm)
modelview_2 = ModelViewKaramba3D(Model=analyse_2.AnalysedModel)  # -> Model, DeformedMesh, DeformedAxes, DeformedModel, MaximumDeformation
beamview_2 = BeamViewKaramba3D(Model=modelview_2.Model)  # -> Model, MeshesOfRenderedBeams, DeformedBeamAxes, LegendColours, LegendTags
utilization_2 = UtilizationOfElementsKaramba3D(
    AnalysedModel=beamview_2.Model,
    NumberOfSamplePoints=3,
    ElasticDesign=True,
    GammaM0=1,
    GammaM1=1.1,
    SwayFrame=True,
    WithDetails=False,
    mode="Beams")  # -> Model, Utilization, SigMax_kN_cm², SigMin_kN_cm², TauMax_kN_cm², UtilN, UtilVy, UtilVz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
legend_2 = Legend(Colour=beamview_2.LegendColours, Tags=beamview_2.LegendTags, LegendType=1)
sort_2 = SortList(Keys=flatten(utilization_2.Utilization))  # -> Keys, ValuesA
lastdex_7 = LastIndex(List=sort_2.Keys)
item_17 = ListItem(List=sort_2.Keys, Index=lastdex_7, Wrap=True)
multiplication_51 = Multiplication(A=item_17, B="100")

# ---- group: Deflection Limit
convert_m_to_cm_3 = Panel("100")
multiplication_52 = Multiplication(A=span_m, B=convert_m_to_cm_3)
division_19 = Division(A=multiplication_52, B="240")
smaller_2 = SmallerThan(FirstNumber=analyse_2.MaximumDisplacement_cm, SecondNumber=division_19)  # -> SmallerThan, OrEqualTo
panel_9 = Panel(smaller_2.SmallerThan)

# ----
starts_3 = Curve(item_14)
middles_3 = Curve(simplify(cull_i_10))
ends_3 = Curve(simplify(item_15))
lineelem_10 = CreateLinearElementKaramba3D(
    Line=starts_3,
    Identifier="Starts",
    CrossSection=crosec_2,
    LimitDistance_m=0.005,
    BucklingLengthY_m=-1,
    BucklingLengthZ_m=-1,
    BucklingLengthLT_m=-1,
    Bending=True,
    ToPolylineMaxAngle=0.03,
    ToPolylineTolerance=0.01,
    ToPolylineMaxEdgeLength=0.25,
    New=True,
    Remove=True,
    mode="LineToBeam")  # -> Element, Points, Info
lineelem_11 = CreateLinearElementKaramba3D(
    Line=middles_3,
    Identifier="Middles",
    CrossSection=crosec_2,
    LimitDistance_m=0.005,
    BucklingLengthY_m=-1,
    BucklingLengthZ_m=-1,
    BucklingLengthLT_m=-1,
    Bending=True,
    ToPolylineMaxAngle=0.03,
    ToPolylineTolerance=0.01,
    ToPolylineMaxEdgeLength=0.25,
    New=True,
    Remove=True,
    mode="LineToBeam")  # -> Element, Points, Info
lineelem_12 = CreateLinearElementKaramba3D(
    Line=ends_3,
    Identifier="Ends",
    CrossSection=crosec_2,
    LimitDistance_m=0.005,
    BucklingLengthY_m=-1,
    BucklingLengthZ_m=-1,
    BucklingLengthLT_m=-1,
    Bending=True,
    ToPolylineMaxAngle=0.03,
    ToPolylineTolerance=0.01,
    ToPolylineMaxEdgeLength=0.25,
    New=True,
    Remove=True,
    mode="LineToBeam")  # -> Element, Points, Info
assemble_3 = AssembleModelKaramba3D(
    Elem=flatten([lineelem_11.Element, lineelem_12.Element, lineelem_2.Element, lineelem_10.Element]),
    Support=[supp_5, supp_6],
    Load=flatten([loads_3, beam_loads_3]),
    Joint=flatten([joint_agent_5, joint_agent_6]),
    LimitDistance_m=0.005)  # -> Model, Info, Mass_kg, CentreOfGravity, LoadCaseNames
analyse_3 = AnalyseKaramba3D(Model=assemble_3.Model)  # -> AnalysedModel, MaximumDisplacement_cm, ResultingForce_kN, ChangeOfElasticEnergy_kNm
panel_10 = Panel(analyse_3.MaximumDisplacement_cm)
modelview_3 = ModelViewKaramba3D(Model=analyse_3.AnalysedModel)  # -> Model, DeformedMesh, DeformedAxes, DeformedModel, MaximumDeformation
beamview_3 = BeamViewKaramba3D(Model=modelview_3.Model)  # -> Model, MeshesOfRenderedBeams, DeformedBeamAxes, LegendColours, LegendTags
utilization_3 = UtilizationOfElementsKaramba3D(
    AnalysedModel=beamview_3.Model,
    NumberOfSamplePoints=3,
    ElasticDesign=True,
    GammaM0=1,
    GammaM1=1.1,
    SwayFrame=True,
    WithDetails=False,
    mode="Beams")  # -> Model, Utilization, SigMax_kN_cm², SigMin_kN_cm², TauMax_kN_cm², UtilN, UtilVy, UtilVz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
legend_3 = Legend(Colour=beamview_3.LegendColours, Tags=beamview_3.LegendTags, LegendType=1)
sort_3 = SortList(Keys=flatten(utilization_3.Utilization))  # -> Keys, ValuesA
lastdex_8 = LastIndex(List=sort_3.Keys)
item_18 = ListItem(List=sort_3.Keys, Index=lastdex_8, Wrap=True)
multiplication_53 = Multiplication(A=item_18, B="100")

# ---- group: Deflection Limit
convert_m_to_cm_4 = Panel("100")
multiplication_54 = Multiplication(A=span_m, B=convert_m_to_cm_4)
division_20 = Division(A=multiplication_54, B="240")
smaller_3 = SmallerThan(FirstNumber=analyse_3.MaximumDisplacement_cm, SecondNumber=division_20)  # -> SmallerThan, OrEqualTo
panel_11 = Panel(smaller_3.SmallerThan)

# ---- group: Dowel Shear Utilization
b_forces = BeamForcesKaramba3D(AnalysedModel=utilization_2.Model, BeamsIdentifiers="Dowels", Ts=[0, 1])  # -> Model, NormalForce_kN, ShearForceVz_kN, ShearForceVy_kN, TorsionalMomentMt_kNm, BendingMomentMy_kNm, BendingMomentMz_kNm, LoadCaseIndex
division_21 = Division(DiameterCm=dowel_diameter_cm, B="2")
split = SplitTree(Data=b_forces.ShearForceVz_kN, Masks=flatten("{*;*;*;0}"))  # -> Positive, Negative
split_2 = SplitTree(Data=b_forces.TorsionalMomentMt_kNm, Masks=flatten("{*;*;*;0}"))  # -> Positive, Negative

# ---- group: Dowel Shear Utilization / Shear stress from torsion
convert_kn_m_to_kn_cm = Panel("100")
pow = Power(A=division_21, B="4")
pi = Pi(Factor=1)
multiplication_55 = Multiplication(A=split_2.Positive, B=convert_kn_m_to_kn_cm)
multiplication_56 = Multiplication(A=pi, B=pow)
division_22 = Division(A=multiplication_56, B="2")
multiplication_57 = Multiplication(A=multiplication_55, B=division_21)
division_23 = Division(A=multiplication_57, B=division_22)

# ---- group: Dowel Shear Utilization / Shear stress from shear force
pi_2 = Pi(Factor=1)
sqr = Square(Value=division_21)
multiplication_58 = Multiplication(A=pi_2, B=sqr)
multiplication_59 = Multiplication(A="4", B=split.Positive)
multiplication_60 = Multiplication(A="3", B=multiplication_58)
division_24 = Division(A=multiplication_59, B=multiplication_60)

# ---- group: Dowel Shear Utilization / Combining stresses
sqr_2 = Square(Value=division_24)
sqr_3 = Square(Value=division_23)
addition_6 = Addition(A=sqr_2, B=sqr_3)
sqrt = SquareRoot(Value=addition_6)
division_25 = Division(A=sqrt, B=multiplication_8)

# ---- group: Dowel Shear Utilization (continued)
multiplication_61 = Multiplication(A=division_25, B="100")  # -> flatten(DowelShearUtilization)
sort_4 = SortList(Keys=multiplication_61)  # -> Keys, ValuesA
lastdex_9 = LastIndex(List=sort_4.Keys)
item_19 = ListItem(List=sort_4.Keys, Index=lastdex_9, Wrap=True)
maximum_dowel_shear_utilization = Panel(item_19)

# ----
max = Maximum(A=multiplication_51, B=item_19)

# ----
# Tags
convert_m_to_ft_2 = Panel("3.28084")
multiplication_62 = Multiplication(A=span_m, B=convert_m_to_ft_2)
panel_12 = Panel("""Span: {0} m ({1} ft)
Max. displacement: {2} cm
Less than deflection limit? {3}
Maximum utilization of elements: {4} %
Maximum dowel shear utilization: {5} %""")
expression = Expression(x=span_m, Expression="Format(\"{0:0.00}\", x)")
expression_2 = Expression(x=multiplication_62, Expression="Format(\"{0:0.00}\", x)")
expression_3 = Expression(x=analyse_2.MaximumDisplacement_cm, Expression="Format(\"{0:0.00}\", x)")
expression_4 = Expression(x=panel_9, Expression="Format(\"{0:0.00}\", x)")
expression_5 = Expression(x=max, Expression="Format(\"{0:0}\", x)")
expression_6 = Expression(x=item_19, Expression="Format(\"{0:0}\", x)")
pt_9 = Point(Point(0, 0, 0.1))
move = Move(Geometry=pt_9, Motion="0,-1,0")  # -> Geometry, Transform
xy = XYPlane(Origin=move.Geometry)
format = Format(
    Format=panel_12,
    Culture=127,
    Data0=expression,
    Data1=expression_2,
    Data2=expression_3,
    Data3=expression_4,
    Data4=expression_5,
    Data5=expression_6)
tag = TextTag(Location=xy, Text=format)

# ---- group: Check if max. displacement and max. utilization meet requirements
smaller_4 = SmallerThan(FirstNumber=max, SecondNumber="100")  # -> SmallerThan, OrEqualTo
panel_13 = Panel(smaller_4.SmallerThan)
suirify_2 = Suirify(panel_9)
suirify_3 = Suirify(panel_13)
num = Number(suirify_3)
num_2 = Number(suirify_2)
ma = MassAddition(Input=simplify([num_2, num]))  # -> Result, PartialResults
equals = Equality(FirstNumber=ma.Result, SecondNumber="2")  # -> Equality, Inequality
panel_14 = Panel(equals.Equality)

# ---- group: Dowel Shear Utilization Visualization
bnd = Bounds(Numbers=multiplication_61)
remap_2 = RemapNumbers(Value=multiplication_61, Source=bnd, Target=Domain(0, 1))  # -> Mapped, Clipped
convert_to_m = Panel("100")
gradient = Gradient(LowerLimit=0, UpperLimit=1, Parameter=remap_2.Mapped, stops=[0.15: RGB(255, 130, 160), 0.85: RGB(220, 0, 40)])
division_26 = Division(A=division_21, B=convert_to_m)
pipe = Pipe(Curve=dowels, Radius=division_26, Caps=1)
preview = CustomPreview(Geometry=flatten(pipe), Material=gradient)

# ---- group: Legend
series_4 = Series(Start="0", Step="0.08", Count=10)
gradient_2 = Gradient(LowerLimit=0, UpperLimit=1, Parameter=series_4, stops=[0.15: RGB(255, 130, 160), 0.85: RGB(220, 0, 40)])
pt_10 = ConstructPoint(XCoordinate=0, YCoordinate=series_4, ZCoordinate=0)
pl = ConstructPlane(Origin=pt_10, XAxis=Vector(1, 0, 0), YAxis=Vector(0, 1, 0))
rectangle = Rectangle(Plane=pl, XSize="-0.1 to 0.1", YSize="-0.025 to 0.025", Radius=0)  # -> Rectangle, Length
boundary = BoundarySurfaces(Edges=rectangle.Rectangle)
move_2 = Move(Geometry=boundary, Motion="-0.25,0.025,0")  # -> Geometry, Transform
preview_2 = CustomPreview(Geometry=flatten(move_2.Geometry), Material=gradient_2)
lng_10 = ListLength(List=move_2.Geometry)
x_minus_one = XMinusOne(NumberX=lng_10)
area = Area(Geometry=move_2.Geometry)  # -> Area, Centroid
range = Range(Domain=bnd, Steps=x_minus_one)
round_3 = Round(Number=range)  # -> Nearest, Floor, Ceiling
concat_2 = Concatenate(FragmentA=round_3.Nearest, FragmentB=" %")
tag_2 = TextTag(Location=area.Centroid, Text=concat_2, Colour=ColourSwatch(SwatchColor=RGB(0, 0, 0)))

# ---- group: Dowel Shear Utilization
b_forces_2 = BeamForcesKaramba3D(AnalysedModel=utilization_3.Model, BeamsIdentifiers="Dowels", Ts=[0, 1])  # -> Model, NormalForce_kN, ShearForceVz_kN, ShearForceVy_kN, TorsionalMomentMt_kNm, BendingMomentMy_kNm, BendingMomentMz_kNm, LoadCaseIndex
division_27 = Division(DiameterCm=dowel_diameter_cm, B="2")
split_3 = SplitTree(Data=b_forces_2.ShearForceVz_kN, Masks=flatten("{*;*;*;0}"))  # -> Positive, Negative
split_4 = SplitTree(Data=b_forces_2.TorsionalMomentMt_kNm, Masks=flatten("{*;*;*;0}"))  # -> Positive, Negative

# ---- group: Dowel Shear Utilization / Shear stress from torsion
convert_kn_m_to_kn_cm_2 = Panel("100")
pow_2 = Power(A=division_27, B="4")
pi_3 = Pi(Factor=1)
multiplication_63 = Multiplication(A=split_4.Positive, B=convert_kn_m_to_kn_cm_2)
multiplication_64 = Multiplication(A=pi_3, B=pow_2)
division_28 = Division(A=multiplication_64, B="2")
multiplication_65 = Multiplication(A=multiplication_63, B=division_27)
division_29 = Division(A=multiplication_65, B=division_28)

# ---- group: Dowel Shear Utilization / Shear stress from shear force
pi_4 = Pi(Factor=1)
sqr_4 = Square(Value=division_27)
multiplication_66 = Multiplication(A=pi_4, B=sqr_4)
multiplication_67 = Multiplication(A="4", B=split_3.Positive)
multiplication_68 = Multiplication(A="3", B=multiplication_66)
division_30 = Division(A=multiplication_67, B=multiplication_68)

# ---- group: Dowel Shear Utilization / Combining stresses
sqr_5 = Square(Value=division_30)
sqr_6 = Square(Value=division_29)
addition_7 = Addition(A=sqr_5, B=sqr_6)
sqrt_2 = SquareRoot(Value=addition_7)
division_31 = Division(A=sqrt_2, B=multiplication_8)

# ---- group: Dowel Shear Utilization (continued)
multiplication_69 = Multiplication(A=division_31, B="100")  # -> flatten(DowelShearUtilization)
sort_5 = SortList(Keys=multiplication_69)  # -> Keys, ValuesA
lastdex_10 = LastIndex(List=sort_5.Keys)
item_20 = ListItem(List=sort_5.Keys, Index=lastdex_10, Wrap=True)
maximum_dowel_shear_utilization_2 = Panel(item_20)

# ----
max_2 = Maximum(A=multiplication_53, B=item_20)

# ----
# Tags
convert_m_to_ft_3 = Panel("3.28084")
multiplication_70 = Multiplication(A=span_m, B=convert_m_to_ft_3)
panel_15 = Panel("""Span: {0} m ({1} ft)
Max. displacement: {2} cm
Less than deflection limit? {3}
Maximum utilization of elements: {4} %
Maximum dowel shear utilization: {5} %""")
expression_7 = Expression(x=span_m, Expression="Format(\"{0:0.00}\", x)")
expression_8 = Expression(x=multiplication_70, Expression="Format(\"{0:0.00}\", x)")
expression_9 = Expression(x=analyse_3.MaximumDisplacement_cm, Expression="Format(\"{0:0.00}\", x)")
expression_10 = Expression(x=panel_11, Expression="Format(\"{0:0.00}\", x)")
expression_11 = Expression(x=max_2, Expression="Format(\"{0:0}\", x)")
expression_12 = Expression(x=item_20, Expression="Format(\"{0:0}\", x)")
pt_11 = Point(Point(0, 0, 0.1))
move_3 = Move(Geometry=pt_11, Motion="0,-1,0")  # -> Geometry, Transform
xy_2 = XYPlane(Origin=move_3.Geometry)
format_2 = Format(
    Format=panel_15,
    Culture=127,
    Data0=expression_7,
    Data1=expression_8,
    Data2=expression_9,
    Data3=expression_10,
    Data4=expression_11,
    Data5=expression_12)
tag_3 = TextTag(Location=xy_2, Text=format_2)

# ---- group: Check if max. displacement and max. utilization meet requirements
smaller_5 = SmallerThan(FirstNumber=max_2, SecondNumber="100")  # -> SmallerThan, OrEqualTo
panel_16 = Panel(smaller_5.SmallerThan)
suirify_4 = Suirify(smaller_3.SmallerThan)
suirify_5 = Suirify(panel_16)
num_3 = Number(suirify_5)
num_4 = Number(suirify_4)
ma_2 = MassAddition(Input=simplify([num_4, num_3]))  # -> Result, PartialResults
equals_2 = Equality(FirstNumber=ma_2.Result, SecondNumber="2")  # -> Equality, Inequality
panel_17 = Panel(equals_2.Equality)

# ---- group: Dowel Shear Utilization Visualization
bnd_2 = Bounds(Numbers=multiplication_69)
remap_3 = RemapNumbers(Value=multiplication_69, Source=bnd_2, Target=Domain(0, 1))  # -> Mapped, Clipped
convert_to_m_2 = Panel("100")
gradient_3 = Gradient(LowerLimit=0, UpperLimit=1, Parameter=remap_3.Mapped, stops=[0.15: RGB(255, 130, 160), 0.85: RGB(220, 0, 40)])
division_32 = Division(A=division_27, B=convert_to_m_2)
pipe_2 = Pipe(Curve=dowels_2, Radius=division_32, Caps=1)
preview_3 = CustomPreview(Geometry=flatten(pipe_2), Material=gradient_3)

# ---- group: Legend
series_5 = Series(Start="0", Step="0.08", Count=10)
gradient_4 = Gradient(LowerLimit=0, UpperLimit=1, Parameter=series_5, stops=[0.15: RGB(255, 130, 160), 0.85: RGB(220, 0, 40)])
pt_12 = ConstructPoint(XCoordinate=0, YCoordinate=series_5, ZCoordinate=0)
pl_2 = ConstructPlane(Origin=pt_12, XAxis=Vector(1, 0, 0), YAxis=Vector(0, 1, 0))
rectangle_2 = Rectangle(Plane=pl_2, XSize="-0.1 to 0.1", YSize="-0.025 to 0.025", Radius=0)  # -> Rectangle, Length
boundary_2 = BoundarySurfaces(Edges=rectangle_2.Rectangle)
move_4 = Move(Geometry=boundary_2, Motion="-0.25,0.025,0")  # -> Geometry, Transform
preview_4 = CustomPreview(Geometry=flatten(move_4.Geometry), Material=gradient_4)
lng_11 = ListLength(List=move_4.Geometry)
x_minus_one_2 = XMinusOne(NumberX=lng_11)
area_2 = Area(Geometry=move_4.Geometry)  # -> Area, Centroid
range_2 = Range(Domain=bnd_2, Steps=x_minus_one_2)
round_4 = Round(Number=range_2)  # -> Nearest, Floor, Ceiling
concat_3 = Concatenate(FragmentA=round_4.Nearest, FragmentB=" %")
tag_4 = TextTag(Location=area_2.Centroid, Text=concat_3, Colour=ColourSwatch(SwatchColor=RGB(0, 0, 0)))

# ---- group: Dowel Shear Utilization
b_forces_3 = BeamForcesKaramba3D(AnalysedModel=analyse.AnalysedModel, BeamsIdentifiers="Dowels", Ts=[0, 1])  # -> Model, NormalForce_kN, ShearForceVz_kN, ShearForceVy_kN, TorsionalMomentMt_kNm, BendingMomentMy_kNm, BendingMomentMz_kNm, LoadCaseIndex
division_33 = Division(DiameterCm=dowel_diameter_cm, B="2")
split_5 = SplitTree(Data=b_forces_3.ShearForceVz_kN, Masks=flatten("{*;*;*;0}"))  # -> Positive, Negative
split_6 = SplitTree(Data=b_forces_3.TorsionalMomentMt_kNm, Masks=flatten("{*;*;*;0}"))  # -> Positive, Negative

# ---- group: Dowel Shear Utilization / Shear stress from torsion
convert_kn_m_to_kn_cm_3 = Panel("100")
pow_3 = Power(A=division_33, B="4")
pi_5 = Pi(Factor=1)
multiplication_71 = Multiplication(A=split_6.Positive, B=convert_kn_m_to_kn_cm_3)
multiplication_72 = Multiplication(A=pi_5, B=pow_3)
division_34 = Division(A=multiplication_72, B="2")
multiplication_73 = Multiplication(A=multiplication_71, B=division_33)
division_35 = Division(A=multiplication_73, B=division_34)

# ---- group: Dowel Shear Utilization / Shear stress from shear force
pi_6 = Pi(Factor=1)
sqr_7 = Square(Value=division_33)
multiplication_74 = Multiplication(A=pi_6, B=sqr_7)
multiplication_75 = Multiplication(A="4", B=split_5.Positive)
multiplication_76 = Multiplication(A="3", B=multiplication_74)
division_36 = Division(A=multiplication_75, B=multiplication_76)

# ---- group: Dowel Shear Utilization / Combining stresses
sqr_8 = Square(Value=division_36)
sqr_9 = Square(Value=division_35)
addition_8 = Addition(A=sqr_8, B=sqr_9)
sqrt_3 = SquareRoot(Value=addition_8)
division_37 = Division(A=sqrt_3, B=multiplication_8)

# ---- group: Dowel Shear Utilization (continued)
multiplication_77 = Multiplication(A=division_37, B="100")  # -> flatten(DowelShearUtilization)
sort_6 = SortList(Keys=multiplication_77)  # -> Keys, ValuesA
lastdex_11 = LastIndex(List=sort_6.Keys)
item_21 = ListItem(List=sort_6.Keys, Index=lastdex_11, Wrap=True)
maximum_dowel_shear_utilization_3 = Panel(item_21)

# ----
max_3 = Maximum(A=multiplication_49, B=item_21)

# ----
# Tags
convert_m_to_ft_4 = Panel("3.28084")
multiplication_78 = Multiplication(A=span_m, B=convert_m_to_ft_4)
panel_18 = Panel("""Span: {0} m ({1} ft)
Max. displacement: {2} cm
Less than deflection limit? {3}
Maximum utilization of elements: {4} %
Maximum dowel shear utilization: {5} %""")
expression_13 = Expression(x=span_m, Expression="Format(\"{0:0.00}\", x)")
expression_14 = Expression(x=multiplication_78, Expression="Format(\"{0:0.00}\", x)")
expression_15 = Expression(x=analyse.MaximumDisplacement_cm, Expression="Format(\"{0:0.00}\", x)")
expression_16 = Expression(x=panel_7, Expression="Format(\"{0:0.00}\", x)")
expression_17 = Expression(x=max_3, Expression="Format(\"{0:0}\", x)")
expression_18 = Expression(x=item_21, Expression="Format(\"{0:0}\", x)")
pt_13 = Point(Point(0, 0, 0.1))
move_5 = Move(Geometry=pt_13, Motion="0,-1,0")  # -> Geometry, Transform
xy_3 = XYPlane(Origin=move_5.Geometry)
format_3 = Format(
    Format=panel_18,
    Culture=127,
    Data0=expression_13,
    Data1=expression_14,
    Data2=expression_15,
    Data3=expression_16,
    Data4=expression_17,
    Data5=expression_18)
tag_5 = TextTag(Location=xy_3, Text=format_3)

# ---- group: Check if max. displacement and max. utilization meet requirements
smaller_6 = SmallerThan(FirstNumber=max_3, SecondNumber="100")  # -> SmallerThan, OrEqualTo
panel_19 = Panel(smaller_6.SmallerThan)
suirify_6 = Suirify(panel_7)
suirify_7 = Suirify(panel_19)
num_5 = Number(suirify_7)
num_6 = Number(suirify_6)
ma_3 = MassAddition(Input=simplify([num_6, num_5]))  # -> Result, PartialResults
equals_3 = Equality(FirstNumber=ma_3.Result, SecondNumber="2")  # -> Equality, Inequality
panel_20 = Panel(equals_3.Equality)

# ---- group: Dowel Shear Utilization Visualization
bnd_3 = Bounds(Numbers=multiplication_77)
remap_4 = RemapNumbers(Value=multiplication_77, Source=bnd_3, Target=Domain(0, 1))  # -> Mapped, Clipped
convert_to_m_3 = Panel("100")
gradient_5 = Gradient(LowerLimit=0, UpperLimit=1, Parameter=remap_4.Mapped, stops=[0.15: RGB(255, 130, 160), 0.85: RGB(220, 0, 40)])
division_38 = Division(A=division_33, B=convert_to_m_3)
pipe_3 = Pipe(Curve=dowels_3, Radius=division_38, Caps=1)
preview_5 = CustomPreview(Geometry=flatten(pipe_3), Material=gradient_5)

# ---- group: Legend
series_6 = Series(Start="0", Step="0.08", Count=10)
gradient_6 = Gradient(LowerLimit=0, UpperLimit=1, Parameter=series_6, stops=[0.15: RGB(255, 130, 160), 0.85: RGB(220, 0, 40)])
pt_14 = ConstructPoint(XCoordinate=0, YCoordinate=series_6, ZCoordinate=0)
pl_3 = ConstructPlane(Origin=pt_14, XAxis=Vector(1, 0, 0), YAxis=Vector(0, 1, 0))
rectangle_3 = Rectangle(Plane=pl_3, XSize="-0.1 to 0.1", YSize="-0.025 to 0.025", Radius=0)  # -> Rectangle, Length
boundary_3 = BoundarySurfaces(Edges=rectangle_3.Rectangle)
move_6 = Move(Geometry=boundary_3, Motion="-0.25,0.025,0")  # -> Geometry, Transform
preview_6 = CustomPreview(Geometry=flatten(move_6.Geometry), Material=gradient_6)
lng_12 = ListLength(List=move_6.Geometry)
x_minus_one_3 = XMinusOne(NumberX=lng_12)
area_3 = Area(Geometry=move_6.Geometry)  # -> Area, Centroid
range_3 = Range(Domain=bnd_3, Steps=x_minus_one_3)
round_5 = Round(Number=range_3)  # -> Nearest, Floor, Ceiling
concat_4 = Concatenate(FragmentA=round_5.Nearest, FragmentB=" %")
tag_6 = TextTag(Location=area_3.Centroid, Text=concat_4, Colour=ColourSwatch(SwatchColor=RGB(0, 0, 0)))
